% Simulink data dictionary FAM_parameters_Modeling_of_resistive.sldd

FAM_unstretched_radius = Simulink.Parameter(0.00635, Unit="m")
FAM_unstretched_length = Simulink.Parameter(0.127, Unit="m")
fiber_angle_alpha = Simulink.Parameter(0.576, Unit="rad")
FAM_wall_thickness = Simulink.Parameter(0.0016, Unit="m")
FAM_elasticity = Simulink.Parameter(1780000, Unit="Pa")  % Set to average elasticity modulus value for silicone rubber from MATWEB.