% Simulink data dictionary FAM_parameters_lab_scale.sldd

FAM_unstretched_length = Simulink.Parameter(0.25, Unit="m")
FAM_unstretched_radius = Simulink.Parameter(0.01, Unit="m")
fiber_angle_alpha = Simulink.Parameter(0.6981, Unit="rad")
FAM_wall_thickness = Simulink.Parameter(0.002, Unit="m")
FAM_elasticity = Simulink.Parameter(16700000, Unit="Pa")  % Set to average elasticity modulus value for silicone rubber from MATWEB.